# Dynamo graph CO Check.dyn (Dynamo 1.3.3.4111)

# group: Create a dimension selection pop up
code_block = CodeBlock()
# ---------- code_block.designscript (4 lines) ----------
null;
"An automated tool for checking brick co-ordinating sizes." +
"\n\nSelect a dimension element within a Revit project and CO Check will calculate which are accurate brick co-ordinating (CO-, CO, and CO+) sizes." +
"\n\nWhere dimensions aren't valid CO sizes it will suggest what you should change them to.";
# ----------------------------------------
ui_textnote_data = Custom[UI.TextNote Data](Title=code_block.out0, TextNote=code_block.out1)  # Create Data for TextNote input in UI.MultipleInputForm ++ . Check out www.data-shapes.net for more informations
code_block_2 = CodeBlock { "Select a dimension"; "Select"; true; }
categories = Categories("Dimensions")
ui_selectmodelelements_data = Custom[UI.SelectModelElements Data](InputName=code_block_2.out0, ButtonText=code_block_2.out1, CategoryFilter=categories, SelectSingleElement=code_block_2.out2)  # Creates a Revit element selection input for UI.MultipleInputForm++ . Check out www.data-shapes.net for more infos!
join = List.Join(ui_textnote_data, ui_selectmodelelements_data)
code_block_3 = CodeBlock(inputs=join)
# ---------- code_block_3.designscript (9 lines) ----------
"Co-Ordinating Dimension Check";
null;
"Continue";
inputs;
true;
"https://github.com/StudioLE/DynamoScripts/";
"Cancel";
600;
400;
# ----------------------------------------
ui_multipleinputform = Custom[UI.MultipleInputForm ++](Description_optional=code_block_3.out0, Logo_optional=code_block_3.out1, ButtonText_optional=code_block_3.out2, Inputs=code_block_3.inputs, Toggle=code_block_3.out4, LinkToHelp_optional=code_block_3.out5, Width_optional=code_block_3.out8)  # Create a form with multiple inputs. see www.data-shapes.net for tutorials and infos!

code_block_4 = CodeBlock(x=ui_multipleinputform.User_Inputs) { x[0]; }
watch = Watch(code_block_4)

# group: Take each dimension and calculate the closest CO number above and below
value = Dimension.Value(watch)
convert_between_units = DynamoConvert(value, conversionMetric=Length, conversionFrom=Feet, conversionTo=Millimeters)
code_block_5 = CodeBlock { CO(1); }
div = convert_between_units / code_block_5
floor = Math.Floor(div)
ceiling = Math.Ceiling(div)

# group: Convert the CO number to its dimension in mm
watch_2 = Watch(convert_between_units)
code_block_6 = CodeBlock(floor, ceiling)
# ---------- code_block_6.designscript (37 lines) ----------
// 0
CO(x);
// 1
COMinus(x);
//2
COPlus(x);
// 3
CO(y);
// 4
COMinus(y);
// 5
COPlus(y);

// We'll later need to figure out
// what these relate to so here's
// a helper function
def returnCOType(a)
{
return = [Imperative]
{
if(a == 0 || a == 3)
{
  return = "CO";
}
elseif(a == 1 || a == 4)
{
  return = "CO-";
}
elseif(a == 2 || a == 5)
{
  return = "CO+";
}
else {
 return = "Invalid";
}
}
};
# ----------------------------------------
create = List.Create(code_block_6.out0, code_block_6.out1, code_block_6.out2, code_block_6.out3, code_block_6.out4, code_block_6.out5)
transpose = List.Transpose(create)

# group: Check if the CO dimensions match the element dimension
indexOf = IndexOf(transpose, watch_2, lacing=Longest)
code_block_7 = CodeBlock(x=indexOf) { returnCOType(x); }
string_from_object = FromObject(code_block_7)

# group: Reduce the list to just invalid items
code_block_8 = CodeBlock { "Invalid"; }
allIndicesOf = List.AllIndicesOf(list=string_from_object, item=code_block_8)
getItemAtIndex = List.GetItemAtIndex(list=watch_2, index=allIndicesOf)
getItemAtIndex_2 = List.GetItemAtIndex(list=transpose, index=allIndicesOf)
transpose_2 = List.Transpose(getItemAtIndex_2)

# group: Create a pop up suggesting the nearest CO size to each invalid dimension
code_block_9 = CodeBlock(x=getItemAtIndex, y=transpose_2)
# ---------- code_block_9.designscript (6 lines) ----------
dp(x, 1);
dp(x, 1) + " is not a recognised co-ordinating dimension." +
"\nThese are the closest alternatives:" +
"\nCO-: " + dp(y[1], 1) + ", " + dp(y[4], 1) +
"\nCO:  "  + dp(y[0], 1) + ", " + dp(y[3], 1) +
"\nCO+: " + dp(y[2], 1) + ", " + dp(y[5], 1);
# ----------------------------------------
ui_textnote_data_2 = Custom[UI.TextNote Data](Title=code_block_9.out0, TextNote=code_block_9.out1)
code_block_10 = CodeBlock { "Set text below dimension to"; { "CO Status", "Empty" }; { true, false }; 0; }
ui_radiobuttons_data = Custom[UI.RadioButtons Data](InputName=code_block_10.out0, Keys=code_block_10.out1, Values=code_block_10.out2, DefaultValueIndex=code_block_10.out3)  # Create radio buttons input for UI.MultipleInputForm ++ .

join_2 = List.Join(ui_textnote_data_2, ui_radiobuttons_data)

# group (continued): Create a pop up suggesting the nearest CO size to each invalid dimension
code_block_11 = CodeBlock(inputs=join_2)  # same code as code_block_3
ui_multipleinputform_2 = Custom[UI.MultipleInputForm ++](Description_optional=code_block_11.out0, Logo_optional=code_block_11.out1, ButtonText_optional=code_block_11.out2, Inputs=code_block_11.inputs, Toggle=code_block_11.out4, LinkToHelp_optional=code_block_11.out5, MaxHeight_optional=code_block_11.out7, Width_optional=code_block_11.out8)

# group: Either set below to CO status or leave empty
watch_3 = Watch(watch)
code_block_12 = CodeBlock(x=ui_multipleinputform_2.User_Inputs) { x[0]; }
code_block_13 = CodeBlock { ""; }
if_ = If(test=code_block_12, true=string_from_object, false=code_block_13)

# group: Add the output below the dimension in Revit
setBelowValue = Rhythm.Revit.Elements.Dimension.SetBelowValue(watch_3, if_)
watch_4 = Watch(setBelowValue)

# group: Functions
code_block_14 = CodeBlock()
# ---------- code_block_14.designscript (30 lines) ----------
// CO for x bricks
def CO(x)
{
  return = (brick() + 10) * x;
};

// CO+ for y bricks
def COPlus(y)
{
  return = CO(y) + 10;
};

// CO- for z bricks
def COMinus(z)
{
  return = CO(z) -10;
};

// Return a number n as a string with i decimal places
def dp(n, i)
{
    a = n * Math.Pow(10, i);
    a = Math.Round(a);
    a = a / Math.Pow(10, i);
 a = ToString(a);
 b = String.IndexOf(a, ".");
 c = String.Substring(a, 0, b + i + 1);
 //return = String.Substring("abcdef", 0, 4);
 return = c;
};
# ----------------------------------------

# group: Variables
code_block_15 = CodeBlock()
# ---------- code_block_15.designscript (5 lines) ----------
def brick()
{
  // Set the default CO-
  return = 102.5;
};
# ----------------------------------------
